# Grasshopper definition jointGenerator.gh (Grasshopper 1.0.7)
# plug-ins: Kangaroo2 Components

iv = Slider(0, range=0..100)
portbrep = Brep(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)
int = Integer(iv)
python = GhPythonScript(
    projectDir="/Users/Roll/Desktop/pyPneuMesh-dev/pyPneuMesh",
    jsonRelDir="scripts/testJointGenerator/data/table.jointsdict",
    iv=int)  # -> out, channelP, v, channelRadius, sphereRadius
# ---------- python: Python ----------
__author__ = "Roll"

import rhinoscriptsyntax as rs
import os
import json

jsonDir = os.path.join(projectDir, jsonRelDir)
with open(jsonDir) as iFile:
    js = iFile.read()
    jointsDict = json.loads(js)

print('keys:', jointsDict.keys())

vChannelP = jointsDict['vChannelP']
V = jointsDict['V']

print(vChannelP)

channelP = vChannelP[iv]    # [iChannel, iPoint, xyz] edges of each Channel
v = V[iv]                   # [xyz] center vertex
channelRadius = jointsDict['channelRadius']
sphereRadius = jointsDict['sphereRadius']
# ---------- end python ----------
panel = Panel(python.sphereRadius)
python_2 = GhPythonScript(
    portBrep=portbrep,
    channelP=python.channelP,
    v=python.v,
    channelRadius=python.channelRadius,
    sphereRadius=python.sphereRadius)  # -> out, sphere, channels; inputs channelP: list, v: list
# ---------- python_2: Python ----------
__author__ = "Roll"

import rhinoscriptsyntax as rs

channels = []

for iP0 in range(len(channelP) - 1):
    for iP1 in range(len(channelP) - (1 + iP0)):
        iP1 = iP0 + iP1 + 1
        
        P0 = channelP[iP0]
        P1 = channelP[iP1]
        
        p0 = rs.AddPoint(P0[0])
        p1 = rs.AddPoint(P1[0])
        
        vec = rs.PointSubtract(p0, p1)
        l = rs.VectorLength(vec)
        if l < channelRadius * 0.2:
            pass
            P1[0] = P0[0]
        


for P in channelP:
    ps = [rs.AddPoint(p) for p in P]
    print(len(ps))
    if len(ps)<= 1:
        continue
    channel = rs.AddCurve(ps, 3)
    channels.append(channel)

sphere = rs.AddSphere((0,0,0), sphereRadius)


rs.ScaleObjects(channels, (0,0,0), (100,100,100))
rs.ScaleObject(sphere, (0,0,0), (100, 100, 100))
# ---------- end python_2 ----------
multiplication = Multiplication(A=python.channelRadius, B=10)
mp = MultiPipe(Curves=python_2.channels, NodeSize=multiplication, EndOffset=1, StrutSize=1, Segment=0, KinkAngle=0.6, CubeFit=0, Caps=1)
material = CreateMaterial(Diffuse=RGB(255, 131, 193), Specular=RGB(255, 254, 254), Emission=RGB(0, 0, 0), Transparency=0.8, Shine=0)
preview = CustomPreview(Geometry=python_2.sphere, Material=material)
