# Grasshopper definition jointGeneratorPillbug.gh (Grasshopper 1.0.7)
# plug-ins: Kangaroo2 Components, Human

number_slider = Slider(2, range=1..20)
jointindex = Panel("17")
labelorientation = Slider(60.67, range=0..360)
bake = Button()
int = Integer(jointindex)

font = Panel("1 2")
c_script = CSharpScript()  # -> fonts
# ---------- c_script: C# ----------
    fonts = Rhino.DocObjects.Font.AvailableFontFaceNames();
# ---------- end c_script ----------
item = ListItem(List=c_script, Index=Slider(0, range=0..423), Wrap=True)
lng = ListLength(List=c_script)
font_2 = Panel(item)
panel = Panel("20")
pt = Point(Point(27, -6, 0))
c_script_2 = CSharpScript(face=font_2, bold=Toggle(False), italics=Toggle(True), size=number_slider, content=int)  # -> out, A; inputs face: String, bold: Boolean, italics: Boolean, size: Double, content: String
# ---------- c_script_2: C# usings ----------
using System.IO;
using System.Linq;
using System.Data;
using System.Drawing;
using System.Reflection;
using System.Windows.Forms;
using System.Xml;
using System.Xml.Linq;
using System.Runtime.InteropServices;

using Rhino.DocObjects;
using Rhino.Collections;
using GH_IO;
using GH_IO.Serialization;
# ---------- c_script_2: C# ----------
    if(content != null && content != String.Empty
    && face != null && face != String.Empty ){

      if(size == 0)
        size = 5;

      Rhino.DocObjects.Font.FontStyle fontStyle = Rhino.DocObjects.Font.FontStyle.Upright;
      if (italics) fontStyle = Rhino.DocObjects.Font.FontStyle.Italic;
      Rhino.DocObjects.Font.FontWeight fontWeight = Rhino.DocObjects.Font.FontWeight.Normal;
      if (bold) fontWeight = Rhino.DocObjects.Font.FontWeight.Bold;

      bool underlined = false;
      bool strikethrough = false;

      Rhino.DocObjects.Font font = new Rhino.DocObjects.Font(face, fontWeight, fontStyle, underlined, strikethrough);


      TextEntity text_entity = new TextEntity
        {
          Plane = Plane.WorldXY,
          PlainText = content,
          Justification = TextJustification.MiddleCenter,
          Font = font
          };
      Rhino.DocObjects.DimensionStyle dimstyle = new Rhino.DocObjects.DimensionStyle();
      dimstyle.TextHeight = size;
      double smallCapsScale = 1;
      double spacing = 0;
      A = text_entity.CreateSurfaces(dimstyle, smallCapsScale, spacing);



    } else {

      Print("Some content is required.");

    }
# ---------- end c_script_2 ----------

panel_2 = Panel("scripts/generateJoint_pillbug_2023_08_16/data/pillbug.jointsdict")

font_3 = Panel("X")
c_script_3 = CSharpScript()  # -> fonts; same code as c_script
item_2 = ListItem(List=c_script_3, Index=Slider(0, range=0..423), Wrap=True)
lng_2 = ListLength(List=c_script_3)
font_4 = Panel(item_2)
pt_2 = Point(Point(27, -6, 0))
c_script_4 = CSharpScript(face=font_4, bold=Toggle(False), italics=Toggle(True), size=number_slider, content=font_3)  # -> out, A; inputs face: String, bold: Boolean, italics: Boolean, size: Double, content: String
# ---------- c_script_4: C# ----------
    if(content != null && content != String.Empty
    && face != null && face != String.Empty ){

      if(size == 0)
        size = 5;

      Rhino.DocObjects.Font.FontStyle fontStyle = Rhino.DocObjects.Font.FontStyle.Upright;
      if (italics) fontStyle = Rhino.DocObjects.Font.FontStyle.Italic;
      Rhino.DocObjects.Font.FontWeight fontWeight = Rhino.DocObjects.Font.FontWeight.Normal;
      if (bold) fontWeight = Rhino.DocObjects.Font.FontWeight.Bold;

      bool underlined = false;
      bool strikethrough = false;

      Rhino.DocObjects.Font font = new Rhino.DocObjects.Font(face, fontWeight, fontStyle, underlined, strikethrough);


      TextEntity text_entity = new TextEntity
        {
          Plane = Plane.WorldXY,
          PlainText = content,
          Justification = TextJustification.MiddleCenter,
          Font = font
          };
      Rhino.DocObjects.DimensionStyle dimstyle = new Rhino.DocObjects.DimensionStyle();
      dimstyle.TextHeight = size;
      double smallCapsScale = 1;
      double spacing = 0;
      A = text_entity.CreateSurfaces(dimstyle, smallCapsScale, spacing);



    } else {

      Print("Some content is required.");

    }
# ---------- end c_script_4 ----------

font_5 = Panel("Y")
c_script_5 = CSharpScript()  # -> fonts; same code as c_script
item_3 = ListItem(List=c_script_5, Index=Slider(0, range=0..423), Wrap=True)
lng_3 = ListLength(List=c_script_5)
font_6 = Panel(item_3)
pt_3 = Point(Point(27, -6, 0))
c_script_6 = CSharpScript(face=font_6, bold=Toggle(False), italics=Toggle(True), size=number_slider, content=font_5)  # -> out, A; inputs face: String, bold: Boolean, italics: Boolean, size: Double, content: String; same code as c_script_4

font_7 = Panel("Z")
c_script_7 = CSharpScript()  # -> fonts; same code as c_script
item_4 = ListItem(List=c_script_7, Index=Slider(0, range=0..423), Wrap=True)
lng_4 = ListLength(List=c_script_7)
number_slider_2 = Slider(12, range=1..20)
font_8 = Panel(item_4)
pt_4 = Point(Point(27, -6, 0))
c_script_8 = CSharpScript(face=font_8, bold=Toggle(False), italics=Toggle(True), size=number_slider, content=font_7)  # -> out, A; inputs face: String, bold: Boolean, italics: Boolean, size: Double, content: String; same code as c_script_4

portbrepbig = Brep(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)
int_2 = Integer(int)
python = GhPythonScript(projectDir="/Users/Roll/Desktop/pyPneuMesh-dev/pyPneuMesh", jsonRelDir=panel_2, iv=int_2)  # -> out, channelP, v, channelRadius, sphereRadius
# ---------- python: Python ----------
__author__ = "Roll"

import rhinoscriptsyntax as rs
import os
import json

jsonDir = os.path.join(projectDir, jsonRelDir)
with open(jsonDir) as iFile:
    js = iFile.read()
    jointsDict = json.loads(js)

print('keys:', jointsDict.keys())

vChannelP = jointsDict['vChannelP']
V = jointsDict['V']

#print(vChannelP)

channelP = vChannelP[iv]    # [iChannel, iPoint, xyz] edges of each Channel
v = V[iv]                   # [xyz] center vertex
channelRadius = jointsDict['channelRadius']
sphereRadius = jointsDict['sphereRadius']


channelP = [[[p[0]*1000, p[1] * 1000, p[2]*1000] for p in P] for P in channelP]
v = [v[0]*1000, v[1]*1000, v[2]*1000]
channelRadius *= 1000
sphereRadius *= 1000
# ---------- end python ----------
portbrep = Brep(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)
python_2 = GhPythonScript(
    portBrep=portbrep,
    channelP=python.channelP,
    v=python.v,
    channelRadius=python.channelRadius,
    sphereRadius=python.sphereRadius)  # -> out, sphere, channels, ports; inputs channelP: list, v: list
# ---------- python_2: Python ----------
__author__ = "Roll"

import rhinoscriptsyntax as rs
import math

channels = []

for iP0 in range(len(channelP) - 1):
    for iP1 in range(len(channelP) - (1 + iP0)):
        iP1 = iP0 + iP1 + 1
        
        P0 = channelP[iP0]
        P1 = channelP[iP1]
        
        p0 = rs.AddPoint(P0[0])
        p1 = rs.AddPoint(P1[0])
        
        vec = rs.PointSubtract(p0, p1)
        l = rs.VectorLength(vec)
        if l < channelRadius * 0.2:
            P1[0] = P0[0]

bboxPort = rs.BoundingBox(portBrep)
diameter = abs(bboxPort[0][0] - bboxPort[1][0])
radius = diameter / 2.0
d = math.sqrt(sphereRadius ** 2 - radius ** 2)


ports = []
for P in channelP:
    pEnd = rs.AddPoint(P[-1])
    pPortStart = rs.VectorScale(pEnd, d / rs.VectorLength(pEnd))
    pPortEnd = rs.VectorScale(pPortStart, 2.0)
    port = rs.CopyObject(portBrep)  # TODO
    rs.OrientObject(port, [(0,0,0),(0,0,1)],[pPortStart, pPortEnd])
    ports.append(port)
    channels.append(rs.AddLine(pEnd, pPortStart))

for P in channelP:
    ps = [rs.AddPoint(p) for p in P]
    if rs.VectorLength(rs.PointSubtract(ps[0], ps[-1])) < 1e-3:
        continue
    
    if len(ps)<= 1:
        continue
    channel = rs.AddCurve(ps, 2)
    channels.append(channel)

sphere = rs.AddSphere((0,0,0), sphereRadius)
# ---------- end python_2 ----------
panel_6 = Panel(python.sphereRadius)
pipe = Pipe(Curve=python_2.channels, Radius=1, Caps=2)
material = CreateMaterial(Diffuse=RGB(255, 131, 193), Specular=RGB(255, 254, 254), Emission=RGB(0, 0, 0), Transparency=0.8, Shine=0)
mp = MultiPipe(
    Curves=python_2.channels,
    NodeSize=python.channelRadius,
    EndOffset=1,
    StrutSize=1,
    Segment=0,
    KinkAngle=0.6,
    CubeFit=0,
    Caps=1)
preview = CustomPreview(Geometry=python_2.sphere, Material=material)
merge = Merge(Data1=python_2.sphere, Data2=mp)
id = Extrude(Base=c_script_2.A, Direction="0,0,1.5")
X = Extrude(Base=c_script_4.A, Direction="0,0,1.5")
Y = Extrude(Base=c_script_6.A, Direction="0,0,1.5")
Z = Extrude(Base=c_script_8.A, Direction="0,0,1.5")
sdiff = SolidDifference(BrepsA=python_2.sphere, BrepsB=mp)
preview_2 = CustomPreview(
    Geometry=python_2.channels,
    Material={diffuse=RGB(228, 178, 227), emission=RGB(68, 53, 68), shine=0.5, specular=RGB(255, 254, 254), transparency=0})
sphereradius = GhPythonScript(id=int, sphereRadius=python.sphereRadius)  # -> out, translation
# ---------- sphereradius: Python ----------
__author__ = "Roll"

import rhinoscriptsyntax as rs

x = (id + 1) * (sphereRadius * 3 * 1.5)


translation = rs.CreateVector([x, 0, 0])
# ---------- end sphereradius ----------
python_3 = GhPythonScript(label=id, sphereRadius=python.sphereRadius, angle=labelorientation)  # -> out, outputs; inputs label: list
# ---------- python_3: Python ----------
__author__ = "Roll"

import rhinoscriptsyntax as rs

bbox = rs.BoundingBox(label)


a = rs.PointAdd(bbox[0], bbox[1])
b = rs.PointAdd(bbox[2], bbox[3])
centerXY = rs.PointAdd(a, b)
centerXY = rs.PointScale(centerXY, 0.25)
startX = rs.PointAdd(centerXY, [1, 0, 0])
startY = rs.PointAdd(centerXY, [0, 1, 0])
startZ = rs.PointAdd(centerXY, [0, 0, 1])

sphereRadius -= 1

targetX = [sphereRadius, 1, 0]
targetY = [sphereRadius, 0, 1]
targetZ = [sphereRadius + 1, 0, 0]

outputs = []
for l in label:
    a = rs.OrientObject(l, (startX, startY, startZ), (targetX, targetY, targetZ))
    a = rs.CopyObject(a)
    rs.RotateObject(a, (0,0,0), float(angle))
    outputs.append(a)
# ---------- end python_3 ----------
python_4 = GhPythonScript(label=X, sphereRadius=python.sphereRadius)  # -> out, a
# ---------- python_4: Python ----------
__author__ = "Roll"

import rhinoscriptsyntax as rs

bbox = rs.BoundingBox(label)

a = rs.PointAdd(bbox[0], bbox[1])
b = rs.PointAdd(bbox[2], bbox[3])
centerXY = rs.PointAdd(a, b)
centerXY = rs.PointScale(centerXY, 0.25)
startX = rs.PointAdd(centerXY, [1, 0, 0])
startY = rs.PointAdd(centerXY, [0, 1, 0])
startZ = rs.PointAdd(centerXY, [0, 0, 1])


sphereRadius -= 1

targetX = [sphereRadius, 1, 0]
targetY = [sphereRadius, 0, 1]
targetZ = [sphereRadius + 1, 0, 0]

a = rs.OrientObject(label, (startX, startY, startZ), (targetX, targetY, targetZ))
# ---------- end python_4 ----------
python_5 = GhPythonScript(label=Y, sphereRadius=python.sphereRadius)  # -> out, a
# ---------- python_5: Python ----------
__author__ = "Roll"

import rhinoscriptsyntax as rs

bbox = rs.BoundingBox(label)

a = rs.PointAdd(bbox[0], bbox[1])
b = rs.PointAdd(bbox[2], bbox[3])
centerXY = rs.PointAdd(a, b)
centerXY = rs.PointScale(centerXY, 0.25)
startX = rs.PointAdd(centerXY, [1, 0, 0])
startY = rs.PointAdd(centerXY, [0, 1, 0])
startZ = rs.PointAdd(centerXY, [0, 0, 1])


sphereRadius -= 1

targetX = [-1, sphereRadius, 0]
targetY = [0, sphereRadius, 1]
targetZ = [0, sphereRadius + 1, 0]

a = rs.OrientObject(label, (startX, startY, startZ), (targetX, targetY, targetZ))
# ---------- end python_5 ----------
python_6 = GhPythonScript(label=Z, sphereRadius=python.sphereRadius)  # -> out, a
# ---------- python_6: Python ----------
__author__ = "Roll"

import rhinoscriptsyntax as rs

bbox = rs.BoundingBox(label)

a = rs.PointAdd(bbox[0], bbox[1])
b = rs.PointAdd(bbox[2], bbox[3])
centerXY = rs.PointAdd(a, b)
centerXY = rs.PointScale(centerXY, 0.25)
startX = rs.PointAdd(centerXY, [1, 0, 0])
startY = rs.PointAdd(centerXY, [0, 1, 0])
startZ = rs.PointAdd(centerXY, [0, 0, 1])


sphereRadius -= 1

targetX = [1, 0, sphereRadius]
targetY = [0, 1, sphereRadius]
targetZ = [0, 0, sphereRadius+1]

a = rs.OrientObject(label, (startX, startY, startZ), (targetX, targetY, targetZ))
# ---------- end python_6 ----------
merge_2 = Merge(Data1=python_2.ports, Data2=python_3.outputs, Data3=python_4.a, Data4=python_5.a, Data5=python_6.a, Data6=merge)
move = Move(Geometry=merge_2, Motion=sphereradius.translation)  # -> Geometry, Transform
bake_2 = BakeGeometry(Bake=bake, Geometry=move.Geometry, DeleteOldBakes=False, PreserveTrees=False)
previewlw = CustomPreviewLineweights(
    Geometry=python_3.outputs,
    Shader={diffuse=RGB(255, 131, 193), emission=RGB(76, 39, 58), shine=0.5, specular=RGB(255, 254, 254), transparency=0},
    Absolute=False)
